# Dynamo graph VIBE_executor.dyn "Home.2dyn" (Dynamo 3.6.1.9895)

file_path = Filename("C:\Users\ayber\OneDrive\Masaüstü\ProjectX\revit_data.json")
now = DateTime.Now()
python_script = Python(IN[0]=file_path, IN[1]=now)  # CPython3
# ---------- python_script.python (147 lines) ----------
import clr
import json
import os
import time

clr.AddReference("RevitServices")
from RevitServices.Persistence import DocumentManager
from RevitServices.Transactions import TransactionManager

clr.AddReference("RevitAPI")
from Autodesk.Revit.DB import ElementId, BuiltInParameter

doc = DocumentManager.Instance.CurrentDBDocument

json_path = IN[0]
tick = IN[1]  # tetik için

lock_path = json_path + ".lock"

def acquire_lock(timeout_sec=2.0, poll=0.05):
    t0 = time.time()
    while True:
        try:
            if not os.path.exists(lock_path):
                f = open(lock_path, "w")
                f.write("lock")
                f.close()
                return True
            else:
                raise Exception("locked")
        except:
            if time.time() - t0 > timeout_sec:
                return False
            time.sleep(poll)

def release_lock():
    try:
        if os.path.exists(lock_path):
            os.remove(lock_path)
    except:
        pass

def safe_read_json(max_retry=10, poll=0.05):
    if not os.path.exists(json_path):
        return {}
    for _ in range(max_retry):
        got = acquire_lock(1.5, poll)
        if not got:
            time.sleep(poll)
            continue
        try:
            f = open(json_path, "r")
            txt = f.read()
            f.close()
            txt = (txt or "").strip()
            if not txt:
                return {}
            return json.loads(txt)
        except:
            time.sleep(poll)
        finally:
            release_lock()
    return {}

def safe_write_json(data):
    got = acquire_lock(2.0, 0.05)
    if not got:
        raise Exception("JSON kilitli (Flask yazıyor olabilir).")
    try:
        tmp = json_path + ".tmp"
        txt = json.dumps(data, indent=4, ensure_ascii=False)  # ✅ str
        f = open(tmp, "w")
        f.write(txt)  # ✅ bytes yok
        f.close()
        if os.path.exists(json_path):
            try:
                os.remove(json_path)
            except:
                pass
        os.rename(tmp, json_path)
    finally:
        release_lock()

def get_comments_param(el):
    p = el.get_Parameter(BuiltInParameter.ALL_MODEL_INSTANCE_COMMENTS)
    if p:
        return p
    return el.LookupParameter("Comments") or el.LookupParameter("Yorumlar") or el.LookupParameter("Açıklamalar")

data = safe_read_json()

locked_ids = []
for eid, obj in (data or {}).items():
    if isinstance(obj, dict) and obj.get("Kilit") == True:
        locked_ids.append(eid)

updated = 0
skipped = 0
errors = []

if locked_ids:
    TransactionManager.Instance.EnsureInTransaction(doc)

    for eid_str in locked_ids:
        obj = data.get(eid_str, {})
        note = (obj.get("Asistan_Notu") or "").strip()

        if not note:
            obj["Kilit"] = False
            skipped += 1
            continue

        try:
            el = doc.GetElement(ElementId(int(eid_str)))
            if el is None:
                obj["Kilit"] = False
                obj["LastError"] = "Element bulunamadı"
                skipped += 1
                continue

            p = get_comments_param(el)
            if p is None or p.IsReadOnly:
                obj["Kilit"] = False
                obj["LastError"] = "Comments parametresi yok veya read-only"
                skipped += 1
                continue

            p.Set(note)
            obj["Kilit"] = False
            obj["LastError"] = ""
            obj["LastWrite"] = time.strftime("%H:%M:%S")
            updated += 1

        except Exception as e:
            obj["LastError"] = str(e)
            errors.append("ID {}: {}".format(eid_str, str(e)))

    TransactionManager.Instance.TransactionTaskDone()

try:
    safe_write_json(data)
except Exception as e:
    errors.append("JSON yazma hatası: " + str(e))

OUT = "Bekleniyor... ({} kilitli | {} güncellendi | {} atlandı | {} hata)".format(
    len(locked_ids), updated, skipped, len(errors)
), errors
# ----------------------------------------
watch = Watch(python_script)
