# Dynamo graph VIBE_executor.dyn "Home.2dyn" (Dynamo 3.6.1.9895)

file_path = Filename("C:\Users\ayber\OneDrive\Masaüstü\ProjectX\revit_data.json")
now = DateTime.Now()
python_script = Python(IN[0]=file_path, IN[1]=now)  # CPython3
# ---------- python_script.python (173 lines) ----------
import clr
import json
import os
import time

clr.AddReference("RevitServices")
from RevitServices.Persistence import DocumentManager
from RevitServices.Transactions import TransactionManager

clr.AddReference("RevitAPI")
from Autodesk.Revit.DB import (
    FilteredElementCollector,
    BuiltInCategory,
    BuiltInParameter,
    ElementId
)

doc  = DocumentManager.Instance.CurrentDBDocument
json_path = IN[0]
tick      = IN[1]

lock_path = json_path + ".lock"

# ── Revit 2025 uyumlu ID yardımcıları ────────────────────
def eid_to_str(element_id):
    """ElementId → string (Revit 2024 ve 2025 uyumlu)"""
    try:
        return str(element_id.Value)          # Revit 2025+
    except AttributeError:
        return str(element_id.IntegerValue)   # Revit 2024 ve öncesi

def str_to_eid(s):
    """string → ElementId (Revit 2024 ve 2025 uyumlu)"""
    return ElementId(int(s))

# ── Lock helpers ──────────────────────────────────────────
def acquire_lock(timeout_sec=2.0, poll=0.05):
    t0 = time.time()
    while True:
        try:
            if not os.path.exists(lock_path):
                f = open(lock_path, "w"); f.write("lock"); f.close()
                return True
            raise Exception("locked")
        except:
            if time.time() - t0 > timeout_sec: return False
            time.sleep(poll)

def release_lock():
    try:
        if os.path.exists(lock_path): os.remove(lock_path)
    except: pass

def write_json(data):
    got = acquire_lock()
    if not got: raise Exception("Kilitli")
    try:
        tmp = json_path + ".tmp"
        f = open(tmp, "w"); f.write(json.dumps(data, indent=4, ensure_ascii=False)); f.close()
        if os.path.exists(json_path): os.remove(json_path)
        os.rename(tmp, json_path)
    finally:
        release_lock()

def read_json():
    if not os.path.exists(json_path): return {}
    got = acquire_lock()
    if not got: return {}
    try:
        f = open(json_path, "r"); txt = f.read(); f.close()
        txt = (txt or "").strip()
        if len(txt) <= 2: return {}
        return json.loads(txt)
    except: return {}
    finally: release_lock()

def get_comments_param(el):
    p = el.get_Parameter(BuiltInParameter.ALL_MODEL_INSTANCE_COMMENTS)
    if p: return p
    return (el.LookupParameter("Comments") or
            el.LookupParameter("Yorumlar") or
            el.LookupParameter("Aciklamalar"))

CAT_MAP = {
    "roof":      BuiltInCategory.OST_Roofs,
    "wall":      BuiltInCategory.OST_Walls,
    "floor":     BuiltInCategory.OST_Floors,
    "door":      BuiltInCategory.OST_Doors,
    "window":    BuiltInCategory.OST_Windows,
    "ceiling":   BuiltInCategory.OST_Ceilings,
    "stair":     BuiltInCategory.OST_Stairs,
    "column":    BuiltInCategory.OST_StructuralColumns,
    "beam":      BuiltInCategory.OST_StructuralFraming,
    "railing":   BuiltInCategory.OST_StairsRailing,
    "room":      BuiltInCategory.OST_Rooms,
    "furniture": BuiltInCategory.OST_Furniture,
    "light":     BuiltInCategory.OST_LightingFixtures,
}

# ── AŞAMA 1: Mevcut veriyi oku ───────────────────────────
data = read_json()
log  = []
export_count = 0

# ── AŞAMA 2: Eksik elementleri Revit'ten doldur ──────────
for cat_key, bic in CAT_MAP.items():
    try:
        els = FilteredElementCollector(doc)\
              .OfCategory(bic)\
              .WhereElementIsNotElementType()\
              .ToElements()
        cat_count = 0
        for el in els:
            eid = eid_to_str(el.Id)
            if eid in data:
                continue
            try: tip = el.Category.Name
            except: tip = cat_key
            try:
                p = get_comments_param(el)
                existing = (p.AsString() or "") if p else ""
            except: existing = ""
            data[eid] = {
                "tip":          tip,
                "cat_key":      cat_key,
                "Asistan_Notu": existing,
                "Kilit":        False,
                "LastError":    "",
                "LastWrite":    ""
            }
            export_count += 1
            cat_count += 1
        log.append("{}: {}".format(cat_key, cat_count))
    except Exception as e:
        log.append("{}: HATA {}".format(cat_key, str(e)[:60]))

if export_count > 0:
    write_json(data)

# ── AŞAMA 3: Kilitli elementleri Revit'e yaz ─────────────
locked = [e for e, o in data.items() if isinstance(o, dict) and o.get("Kilit")]
updated = skipped = 0
errors  = []

if locked:
    TransactionManager.Instance.EnsureInTransaction(doc)
    for eid_str in locked:
        obj  = data[eid_str]
        note = (obj.get("Asistan_Notu") or "").strip()
        if not note:
            obj["Kilit"] = False; skipped += 1; continue
        try:
            el = doc.GetElement(str_to_eid(eid_str))
            if el is None:
                obj["Kilit"] = False; obj["LastError"] = "Bulunamadi"; skipped += 1; continue
            p = get_comments_param(el)
            if p is None or p.IsReadOnly:
                obj["Kilit"] = False; obj["LastError"] = "Read-only"; skipped += 1; continue
            p.Set(note)
            obj["Kilit"] = False; obj["LastError"] = ""; obj["LastWrite"] = time.strftime("%H:%M:%S")
            updated += 1
        except Exception as e:
            obj["LastError"] = str(e); errors.append(str(e)[:80])
    TransactionManager.Instance.TransactionTaskDone()
    write_json(data)

OUT = (
    "Export: +{} | Toplam: {} | Kilitli: {} | Yazilan: {} | Atlanan: {} | Hata: {}\n{}".format(
        export_count, len(data), len(locked), updated, skipped, len(errors),
        " | ".join(log)
    ),
    errors
)
# ----------------------------------------
watch = Watch(python_script)
